# Grasshopper definition CHEATSHEET.gh (Grasshopper 1.0.7)
# Copyright: bernhard muller bijoutiers
# plug-ins: Workshop

# CHEATSHEET - Rhino Script Syntax
# WICKERSON STUDIOS
# SUBSCRIBE TO PATREON:
# https://www.patreon.com/MichaelWickerson?fan_landing=true
wickerson_s_first_grasshopper_component = WickersonsFirstGrasshopperComponent()
# Selection and Input
panel = Panel("Wickerson Studios Kicks Butt!")

# ---- group: rs.GetString()
ghpython_script = GhPythonScript(x=panel)  # -> out, a
# ---------- ghpython_script: Python ----------
import rhinoscriptsyntax as rs

print x
a = rs.GetString(message=None, defaultString="Wickerson Studios", strings="Wickerson")
# ---------- end ghpython_script ----------

# ----
panel_2 = Panel(ghpython_script.out)
panel_3 = Panel(ghpython_script.a)
