# Grasshopper definition selection_and_input_001.gh (Grasshopper 1.0.7)
# Copyright: bernhard muller bijoutiers
# plug-ins: Workshop

# CHEATSHEET - Rhino Script Syntax
# WICKERSON STUDIOS
# SUBSCRIBE TO PATREON:
# https://www.patreon.com/MichaelWickerson?fan_landing=true
wickerson_s_first_grasshopper_component = WickersonsFirstGrasshopperComponent()

# ---- group: rs.GetString()
ghpython_script = GhPythonScript()  # -> out, a; disabled
# ---------- ghpython_script: Python ----------
import rhinoscriptsyntax as rs

a = rs.CurrentLayer()
a = rs.GetString("Layer to set current", a)
if a: 
    rs.CurrentLayer(a)
# ---------- end ghpython_script ----------

# ----
# Selection and Input
panel = Panel("1234567890")  # disabled
panel_2 = Panel("1234567890")  # disabled
panel_3 = Panel("1234567890")  # disabled
panel_4 = Panel("1234567890")  # disabled
panel_5 = Panel("1234567890")  # disabled
panel_6 = Panel("Wickerson Studios Kicks Butt!")  # disabled
panel_7 = Panel(ghpython_script.a)  # disabled

# ---- group: rs.GetString()
ghpython_script_2 = GhPythonScript(x=panel_6)  # -> out, a; disabled
# ---------- ghpython_script_2: Python ----------
import rhinoscriptsyntax as rs

print x
a = rs.GetString(message=None, defaultString="Wickerson Studios", strings="Wickerson")
# ---------- end ghpython_script_2 ----------

# ---- group: rs.GetInteger()
ghpython_script_3 = GhPythonScript(x=panel)  # -> out, a; inputs x: Int32; disabled
# ---------- ghpython_script_3: Python ----------
import rhinoscriptsyntax as rs

print x
a = rs.GetInteger(message="Enter an integer.", number=123, minimum=0, maximum=256)
# ---------- end ghpython_script_3 ----------

# ---- group: rs.GetReal()
ghpython_script_4 = GhPythonScript(x=panel_2)  # -> out, a; inputs x: Int32; disabled
# ---------- ghpython_script_4: Python ----------
import rhinoscriptsyntax as rs

print x
a = rs.GetReal(message="Number", number=777, minimum=3, maximum=120)
# ---------- end ghpython_script_4 ----------

# ---- group: rs.GetObject
ghpython_script_5 = GhPythonScript(x=panel_3)  # -> out, a; inputs x: Int32; disabled
# ---------- ghpython_script_5: Python ----------
import rhinoscriptsyntax as rs

print x
import rhinoscriptsyntax as rs
"""a = rs.GetObject("Pick any object")
if a:
    print "Object identifier: ", a
"""
a = rs.GetObject("Pick a curve or surface", rs.filter.curve | rs.filter.surface)

if a:
    print "Object identifier: ", a
# ---------- end ghpython_script_5 ----------

# ---- group: rs.GetObjects
ghpython_script_6 = GhPythonScript(x=panel_4)  # -> out, a; inputs x: Int32; disabled
# ---------- ghpython_script_6: Python ----------
print x

import rhinoscriptsyntax as rs

a = []
objectIds = rs.GetObjects("Pick some surfaces", rs.filter.surface)
for id in objectIds: 
    print "Object identifier:", id
    a.append(id)
# ---------- end ghpython_script_6 ----------

# ---- group: rs.PointCoordinates()
ghpython_script_7 = GhPythonScript(x=panel_5)  # -> out, a; inputs x: Int32; disabled
# ---------- ghpython_script_7: Python ----------
print x

import rhinoscriptsyntax as rs

a = rs.GetObject("Select point", rs.filter.point)
point = rs.PointCoordinates(a)
if point: 
    print point
# ---------- end ghpython_script_7 ----------

# ----
panel_8 = Panel(ghpython_script_6.out)  # disabled
panel_9 = Panel(ghpython_script_5.out)  # disabled
panel_10 = Panel(ghpython_script_2.out)  # disabled
panel_11 = Panel(ghpython_script_3.a)  # disabled
panel_12 = Panel(ghpython_script_4.a)  # disabled
panel_13 = Panel(ghpython_script_2.a)  # disabled
panel_14 = Panel(ghpython_script_3.out)  # disabled
panel_15 = Panel(ghpython_script_4.out)  # disabled
panel_16 = Panel(ghpython_script_5.a)  # disabled
panel_17 = Panel(ghpython_script_6.a)  # disabled
panel_18 = Panel(ghpython_script_7.out)  # disabled
panel_19 = Panel(ghpython_script_7.a)  # disabled
