# Grasshopper definition transformations_004B.gh (Grasshopper 1.0.7)
# Copyright: bernhard muller bijoutiers
# plug-ins: Workshop, Bifocals

# CHEATSHEET - Rhino Script Syntax
# WICKERSON STUDIOS
# SUBSCRIBE TO PATREON:
# https://www.patreon.com/MichaelWickerson?fan_landing=true
wickerson_s_first_grasshopper_component = WickersonsFirstGrasshopperComponent()  # disabled

# ---- group: rs.GetString()
ghpython_script = GhPythonScript()  # -> out, a; disabled
# ---------- ghpython_script: Python ----------
import rhinoscriptsyntax as rs

a = rs.CurrentLayer()
a = rs.GetString("Layer to set current", a)
if a: 
    rs.CurrentLayer(a)
# ---------- end ghpython_script ----------

# ---- group: rs.VectoLength()
ghpython_script_2 = GhPythonScript()  # -> out, vector; disabled
# ---------- ghpython_script_2: Python ----------
import rhinoscriptsyntax as rs

point1 = rs.GetPoint("First point")
point2 = rs.GetPoint("Next point")
vector = rs.VectorCreate(point2, point1)
print rs.VectorLength(vector)
# ---------- end ghpython_script_2 ----------

# ---- group: rs.VectorAngle()
ghpython_script_3 = GhPythonScript()  # -> out, a, b, n1; disabled
# ---------- ghpython_script_3: Python ----------
#dependent on rs.GetObject with rs.filter.surface
#dependent on rs.SurfaceDomain
#dependent on rs.SurfaceNormal

import rhinoscriptsyntax as rs
s0 = rs.GetObject("Surface 0", rs.filter.surface)
s1 = rs.GetObject("Surface 1", rs.filter.surface)
du0 = rs.SurfaceDomain(s0, 0)
dv0 = rs.SurfaceDomain(s0, 1)
du1 = rs.SurfaceDomain(s1, 0)
dv1 = rs.SurfaceDomain(s1, 1)
n0 = rs.SurfaceNormal(s0, (du0[0], dv0[0]))
n1 = rs.SurfaceNormal(s1, (du1[0], dv1[0]))
a = rs.VectorAngle(n0, n1)
b = rs.VectorAngle(n0, rs.VectorReverse(n1))
print a
print b
# ---------- end ghpython_script_3 ----------

# ----
number_slider = Slider(3.35, range=0..10)  # disabled
plane = Plane(Plane(origin=(-25, 19, 0), x=(0.7893522174, 0.6139406135, 0), y=(0.2540504335, -0.3266362716, 0.9103664775)))  # disabled
curve = Curve(<curve referenced from the Rhino model>)  # disabled
circle = Circle(Plane=plane, Radius=number_slider)  # disabled
rail_1 = Rail1(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)  # disabled
rail_2 = Rail2(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)  # disabled
python = GhPythonScript(x=circle)  # -> out, a; disabled
# ---------- python: Python ----------
__author__ = "Sculpture"
__version__ = "2020.03.15"

import rhinoscriptsyntax as rs

for input in ghenv.Component.Params.Input:
    for source in input.Sources:
        a = str (source.InstanceGuid)
# ---------- end python ----------
python_2 = GhPythonScript(x=curve)  # -> out, a; disabled
# ---------- python_2: Python ----------
import rhinoscriptsyntax as rs

for input in ghenv.Component.Params.Input:
    for source in input.Sources:
        a = str (source.InstanceGuid)
# ---------- end python_2 ----------
sweep2 = Sweep2(Rail1=rail_1, Rail2=rail_2, Sections=circle, SameHeight=False)  # disabled
sweep1 = Sweep1(Rail=curve, Sections=circle, Miter=1)  # disabled
geometry = Geometry(sweep1)  # disabled
geometry_2 = Geometry(sweep2)  # disabled
panel = Panel(python.a)  # disabled

# ---- group: rs.AddSweep1()
ghpython_script_4 = GhPythonScript(shape=python.a, rail=python_2.a)  # -> out, sweep; inputs shape: Guid, rail: Curve; disabled
# ---------- ghpython_script_4: Python ----------
import rhinoscriptsyntax as rs

sweep = rs.AddSweep1(rail, shape)
# ---------- end ghpython_script_4 ----------

# ---- group: rs.AddSweep2()
ghpython_script_5 = GhPythonScript()  # -> out, a; disabled
# ---------- ghpython_script_5: Python ----------
import rhinoscriptsyntax as rs

sweep = rs.AddSweep1(rails, shape)
rs.AddSweep1(
# ---------- end ghpython_script_5 ----------

# ----
# Miscellaneous
# rs.ExtendCurve()
# rs.AddLoftSrf()
# rs.OffsetCurve()
# rs.OffsetSurface()
# rs.ExtrudeSurface()
# rs.AddTextDot()
# rs.ObjectColor()
# rs.CopyObject()
# rs.DeleteObject()
# rs.HideObject()
# rs.EnableRedraw()
# rs.CurvePrepFrame()
# rs.WorldXYPlane()
# rs.ReverseCurve()
# rs.RebuildSurface()
# rs.JoinCurves()
ghpython_script_6 = GhPythonScript()  # -> Out, A; disabled

# ----
# Line, Curve, Surface Evaluation
# rs.Distance()
# rs.DivideCurve()
# rs.CurveMidPoint()
# rs.CurveAreaCentroid()
# rs.CurveStartPoint()
# rs.CurveEndPoint()
# rs.CurveClosestPoint()
# rs.CurveDomain()
# rs.BrepClosestPoint()
# rs.PointClosestPoint()
# rs.CurveDomain()
# rs.SurfaceDomain()
# rs.SurfaceNormal()
# rs.SurfaceAreaCentroid()
# rs.EvaluateSurface()
# rs.PlaneFromNormal()
# rs.DistanceToPlane()
# rs.PlaneFromPlane()
ghpython_script_7 = GhPythonScript()  # -> Out, A; disabled

# ---- group: rs.GetObjects
ghpython_script_8 = GhPythonScript(x="1234567890")  # -> out, a; inputs x: Int32
# ---------- ghpython_script_8: Python ----------
print x

import rhinoscriptsyntax as rs

a = []
objectIds = rs.GetObjects("Pick some surfaces", rs.filter.surface)
for id in objectIds: 
    print "Object identifier:", id
    a.append(id)
# ---------- end ghpython_script_8 ----------

# ---- group: rs.GetObject
ghpython_script_9 = GhPythonScript(x="1234567890")  # -> out, a; inputs x: Int32
# ---------- ghpython_script_9: Python ----------
import rhinoscriptsyntax as rs

rs.GetObject(message=None, filter=0, preselect=False, select=False, custom_filter=None, subobjects=False)
# ---------- end ghpython_script_9 ----------

# ----
panel_2 = Panel(ghpython_script_9.out)
panel_3 = Panel(ghpython_script_9.a)
panel_4 = Panel(ghpython_script_8.out)
panel_5 = Panel(ghpython_script_8.a)

# ----
# Selection and Input
# rs.GetString()
# rs.GetInteger()
# rs.GetReal()
# rs.GetObject()
# rs.GetObjects()
# rs.PointCoordinates()
panel_6 = Panel("1234567890")  # disabled
panel_7 = Panel("Wickerson Studios Kicks Butt!")  # disabled
panel_8 = Panel("1234567890")  # disabled
panel_9 = Panel("1234567890")  # disabled
panel_10 = Panel(ghpython_script.a)  # disabled

# ---- group: rs.GetString()
ghpython_script_10 = GhPythonScript(x=panel_7)  # -> out, a; disabled
# ---------- ghpython_script_10: Python ----------
import rhinoscriptsyntax as rs

print x
a = rs.GetString(message="Enter a string", defaultString="Wickerson Studios", strings="Wickerson")
# ---------- end ghpython_script_10 ----------

# ---- group: rs.GetInteger()
ghpython_script_11 = GhPythonScript(x=panel_6)  # -> out, a; inputs x: Int32; disabled
# ---------- ghpython_script_11: Python ----------
import rhinoscriptsyntax as rs

print x

a = rs.GetInteger(message="Enter an integer.", number=123, minimum=100, maximum=256)
# ---------- end ghpython_script_11 ----------

# ---- group: rs.GetReal()
ghpython_script_12 = GhPythonScript(x=panel_8)  # -> out, a; inputs x: Int32; disabled
# ---------- ghpython_script_12: Python ----------
import rhinoscriptsyntax as rs

print x
a = rs.GetReal(message="Number", number=777, minimum=3, maximum=120)
# ---------- end ghpython_script_12 ----------

# ---- group: rs.PointCoordinates()
ghpython_script_13 = GhPythonScript(x=panel_9)  # -> out, a; inputs x: Int32; disabled
# ---------- ghpython_script_13: Python ----------
print x

import rhinoscriptsyntax as rs

a = rs.GetObject("Select point", rs.filter.point)
point = rs.PointCoordinates(a)
if point: 
    print point
# ---------- end ghpython_script_13 ----------

# ----
panel_11 = Panel(ghpython_script_10.out)  # disabled
panel_12 = Panel(ghpython_script_11.a)  # disabled
panel_13 = Panel(ghpython_script_12.a)  # disabled
panel_14 = Panel(ghpython_script_10.a)  # disabled
panel_15 = Panel(ghpython_script_11.out)  # disabled
panel_16 = Panel(ghpython_script_12.out)  # disabled
panel_17 = Panel(ghpython_script_13.out)  # disabled
panel_18 = Panel(ghpython_script_13.a)  # disabled

# ----
# vectors
# rs.AddPoint()
# rs.VectorCreate()
# rs.VectorUnitize()
# rs.VectorAngle()
# rs.VectorScale()
# rs.VectorLength()
number_slider_2 = Slider(0.44, range=0..10)  # disabled
number_slider_3 = Slider(2.09, range=0..10)  # disabled
number_slider_4 = Slider(0, range=0..10)  # disabled
number_slider_5 = Slider(7.7, range=0..10)  # disabled
number_slider_6 = Slider(1.7, range=0..10)  # disabled
number_slider_7 = Slider(2.09, range=0..10)  # disabled
number_slider_8 = Slider(2.09, range=0..10)  # disabled
number_slider_9 = Slider(2.76, range=0..10)  # disabled
number_slider_10 = Slider(5.64, range=0..10)  # disabled
number_slider_11 = Slider(1.06, range=0..10)  # disabled
number_slider_12 = Slider(1.9, range=0..10)  # disabled
number_slider_13 = Slider(0, range=0..10)  # disabled
number_slider_14 = Slider(2.29, range=0..10)  # disabled
number_slider_15 = Slider(2, range=0..10)  # disabled
number_slider_16 = Slider(10, range=0..10)  # disabled
number_slider_17 = Slider(4, range=0..10)  # disabled
number_slider_18 = Slider(2, range=0..10)  # disabled
number_slider_19 = Slider(3, range=0..10)  # disabled
number_slider_20 = Slider(5, range=0..10)  # disabled
number_slider_21 = Slider(1, range=-2..2)  # disabled
number_slider_22 = Slider(-0.42, range=-2..2)  # disabled
number_slider_23 = Slider(0.28, range=-2..2)  # disabled
construct_point = ConstructPoint(XCoordinate=number_slider_16, YCoordinate=number_slider_4, ZCoordinate=number_slider_17)  # disabled
construct_point_2 = ConstructPoint(XCoordinate=number_slider_4, YCoordinate=number_slider_16, ZCoordinate=number_slider_17)  # disabled
vector = Vector(ghpython_script_2.vector)  # disabled
panel_19 = Panel(ghpython_script_3.a)  # disabled
panel_20 = Panel(ghpython_script_3.out)  # disabled
panel_21 = Panel(ghpython_script_3.b)  # disabled
panel_22 = Panel(ghpython_script_2.out)  # disabled
line = Line(StartPoint=construct_point, EndPoint=construct_point_2)  # disabled
number_slider_24 = Slider(2, range=0..100)  # disabled
number_slider_25 = Slider(1, range=0..100)  # disabled
number_slider_26 = Slider(7, range=0..100)  # disabled
number_slider_27 = Slider(1, range=0..100)  # disabled
number_slider_28 = Slider(1, range=0..100)  # disabled
number_slider_29 = Slider(1.85, range=0..2)  # disabled
amplitude = Amplitude(Vector=ghpython_script_3.n1, Amplitude=number_slider_24)  # disabled
amplitude_2 = Amplitude(Vector=vector, Amplitude=number_slider_27)  # disabled
vector_display = VectorDisplay(Anchor=ghpython_script_3.n1, Vector=amplitude)  # disabled
vector_display_2 = VectorDisplay(Anchor=vector, Vector=amplitude_2)  # disabled

# ---- group: rs.VectorCreate()
ghpython_script_14 = GhPythonScript(
    x=number_slider_5,
    y=number_slider_6,
    z=number_slider_2,
    deltaX=number_slider_7,
    deltaY=number_slider_8,
    deltaZ=number_slider_3)  # -> out, rhino_vector, ghpython_vector; disabled
# ---------- ghpython_script_14: Python ----------
import rhinoscriptsyntax as rs

point1 = rs.GetPoint("First point")
point2 = rs.GetPoint("Next point")
rhino_vector = rs.VectorCreate(point2, point1)
print rhino_vector
"""
point3 = rs.AddPoint(x,y,z)
point4 = rs.AddPoint(deltaX, deltaY,deltaZ)
ghpython_vector = rs.VectorCreate(point3, point4)
print ghpython_vector
"""
# ---------- end ghpython_script_14 ----------

# ---- group: rs.VectorUnitize()
ghpython_script_15 = GhPythonScript(x=number_slider_9, y=number_slider_10, z=number_slider_11)  # -> out, vector; disabled
# ---------- ghpython_script_15: Python ----------
import rhinoscriptsyntax as rs
vector = rs.VectorUnitize( [x,y,z] )
print vector
# ---------- end ghpython_script_15 ----------

# ---- group: rs.VectorScale()
ghpython_script_16 = GhPythonScript(x=number_slider_12, y=number_slider_12, z=number_slider_14, scale=number_slider_15)  # -> out, vector; inputs scale: Int32; disabled
# ---------- ghpython_script_16: Python ----------
import rhinoscriptsyntax as rs

vector = rs.VectorScale([x,y,z], scale)
print vector
# ---------- end ghpython_script_16 ----------

# ---- group: rs.VectoLength()
ghpython_script_17 = GhPythonScript(a=number_slider_16, b=number_slider_4, c=number_slider_17)  # -> out, vector, list; inputs a: Int32, b: Int32, c: Int32; disabled
# ---------- ghpython_script_17: Python ----------
import rhinoscriptsyntax as rs

list = []
for i in range(a):
    x = rs.AddPoint(a,b,c)
    y = rs.AddPoint(a*a,b*b,c*c)
    vector = rs.VectorCreate(x, y)
    vectorList = rs.VectorLength(i*vector)
    list.append(vectorList)
# ---------- end ghpython_script_17 ----------

# ---- group: rs.AddPoint()
ghpython_script_18 = GhPythonScript(
    x=number_slider_18,
    y=number_slider_19,
    z=number_slider_20,
    multX=number_slider_21,
    multY=number_slider_22,
    multZ=number_slider_23)  # -> out, point_out; inputs x: Int32, y: Int32, z: Int32; disabled
# ---------- ghpython_script_18: Python ----------
import rhinoscriptsyntax as rs


point = rs.AddPoint(multX*x,multY*y,multZ*z)
print point

point_out = point
# ---------- end ghpython_script_18 ----------

# ----
panel_23 = Panel(ghpython_script_18.out)  # disabled
panel_24 = Panel(ghpython_script_18.point_out)  # disabled
vector_2 = Vector(ghpython_script_14.rhino_vector)  # disabled
vector_3 = Vector(ghpython_script_14.ghpython_vector)  # disabled
vector_4 = Vector(ghpython_script_15.vector)  # disabled
vector_5 = Vector(ghpython_script_16.vector)  # disabled
vector_6 = Vector(ghpython_script_17.vector)  # disabled
panel_25 = Panel(ghpython_script_17.list)  # disabled
amplitude_3 = Amplitude(Vector=vector_6, Amplitude=ghpython_script_17.list)  # disabled
list_length = ListLength(List=amplitude_3)  # disabled
range = Range(Domain=number_slider_29, Steps=expr("x-1", list_length))  # disabled
amplitude_4 = Amplitude(Vector=vector_2, Amplitude=number_slider_26)  # disabled
amplitude_5 = Amplitude(Vector=vector_3, Amplitude=number_slider_26)  # disabled
amplitude_6 = Amplitude(Vector=vector_4, Amplitude=number_slider_28)  # disabled
amplitude_7 = Amplitude(Vector=vector_5, Amplitude=number_slider_25)  # disabled
rotate = Rotate(Vector=amplitude_3, Axis=line, Angle=range)  # disabled
vector_display_3 = VectorDisplay(Anchor=vector_3, Vector=amplitude_5)  # disabled
vector_display_4 = VectorDisplay(Anchor=vector_4, Vector=amplitude_6)  # disabled
vector_display_5 = VectorDisplay(Anchor=vector_5, Vector=amplitude_7)  # disabled
vector_display_6 = VectorDisplay(Anchor=rotate, Vector=rotate)  # disabled
vector_display_7 = VectorDisplay(Anchor=vector_2, Vector=amplitude_4)  # disabled

# ----
# point, line, surface, geometry
# rs.PointAdd()
# rs.AddPoints()
# rs.AddSrfPt()
# rs.AddLine()
# rs.AddCurve()
# rs.AddCircle()
# rs.AddRectangle()
# rs.AddPlanarSrf()
# rs.AddEllipse()
# rs.AddBox()
# rs.AddCone()
# rs.AddSweep1()
# rs.AddSweep2()
number_slider_30 = Slider(2, range=0..10)  # disabled
number_slider_31 = Slider(0, range=0..10)  # disabled
number_slider_32 = Slider(0, range=0..10)  # disabled
number_slider_33 = Slider(0, range=0..10)  # disabled
number_slider_34 = Slider(10, range=0..10)  # disabled
number_slider_35 = Slider(10, range=0..10)  # disabled
number_slider_36 = Slider(0.8, range=0..2)  # disabled
number_slider_37 = Slider(4.96, range=0..10)  # disabled
number_slider_38 = Slider(4, range=0..10)  # disabled
number_slider_39 = Slider(4.45, range=0..10)  # disabled
point = Point(<point referenced from the Rhino model>)  # disabled
point_2 = Point(<point referenced from the Rhino model>)  # disabled
point_3 = Point(<point referenced from the Rhino model>)  # disabled
point_4 = Point(<point referenced from the Rhino model>)  # disabled
number_slider_40 = Slider(0, range=0..10)  # disabled
number_slider_41 = Slider(4.35, range=0..10)  # disabled
number_slider_42 = Slider(9.91, range=0..10)  # disabled
number_slider_43 = Slider(9, range=0..10)  # disabled
number_slider_44 = Slider(8, range=0..10)  # disabled
number_slider_45 = Slider(5, range=0..10)  # disabled
number_slider_46 = Slider(5.7, range=0..10)  # disabled
number_slider_47 = Slider(6.12, range=0..10)  # disabled
number_slider_48 = Slider(4.59, range=0..10)  # disabled
number_slider_49 = Slider(4, range=0..10)  # disabled
number_slider_50 = Slider(10, range=0..10)  # disabled
number_slider_51 = Slider(1, range=0..10)  # disabled
number_slider_52 = Slider(5, range=1..5)  # disabled
number_slider_53 = Slider(1.7, range=0..2)  # disabled
number_slider_54 = Slider(2, range=0..10)  # disabled
number_slider_55 = Slider(0, range=0..10)  # disabled
number_slider_56 = Slider(5, range=0..10)  # disabled
number_slider_57 = Slider(1, range=0..1)  # disabled
number_slider_58 = Slider(0, range=0..1)  # disabled
number_slider_59 = Slider(0, range=0..1)  # disabled
number_slider_60 = Slider(11, range=0..100)  # disabled
number_slider_61 = Slider(31, range=0..100)  # disabled
number_slider_62 = Slider(5, range=0..10)  # disabled
count = Count(3)  # disabled
region = Region({Plane=PlaneXY(2, -1, 0), Size=Domain2(u=-11..11, v=-12..12)})  # disabled
number_slider_63 = Slider(7, range=0..10)  # disabled
number_slider_64 = Slider(10, range=0..10)  # disabled
construct_point_3 = ConstructPoint(XCoordinate=number_slider_49, YCoordinate=number_slider_50, ZCoordinate=number_slider_51)  # disabled
populate_2d = Populate2D(Region=region, Count=count, Seed=number_slider_63)  # disabled
range_2 = Range(Domain=number_slider_53, Steps=number_slider_62)  # disabled
number_slider_65 = Slider(4.65, range=0..10)  # disabled
number_slider_66 = Slider(8.24, range=0..10)  # disabled
number_slider_67 = Slider(5.12, range=0..10)  # disabled
number_slider_68 = Slider(7.01, range=0..10)  # disabled
construct_point_4 = ConstructPoint(XCoordinate=number_slider_54, YCoordinate=number_slider_55, ZCoordinate=number_slider_56)  # disabled
number_slider_69 = Slider(3.82, range=0..10)  # disabled
number_slider_70 = Slider(5.95, range=0..10)  # disabled
number_slider_71 = Slider(5.12, range=0..10)  # disabled
number_slider_72 = Slider(5.84, range=0..10)  # disabled
pi = Pi(Factor=number_slider_36)  # disabled
explode_tree = ExplodeTree(Data=graft(populate_2d))  # -> Branch0, Branch1, Branch2, Branch3, Branch4; disabled
addition = Addition(A=number_slider_68, B=number_slider_64)  # disabled
pi_2 = Pi(Factor=range_2)  # disabled
plane_2 = Plane(construct_point_3)  # disabled
number_slider_73 = Slider(2, range=2..4)  # disabled
number_slider_74 = Slider(4, range=1..10)  # disabled
plane_3 = Plane(construct_point_4)  # disabled
number_slider_75 = Slider(5, range=1..5)  # disabled
number_slider_76 = Slider(3, range=1..5)  # disabled
number_slider_77 = Slider(9.22, range=0..10)  # disabled
rotate_axis = RotateAxis(Geometry=plane_2, Angle=pi, Axis=Line((0, 0, 0), (10, 0, 0)))  # -> Geometry, Transform; disabled
construct_point_5 = ConstructPoint(XCoordinate=number_slider_30, YCoordinate=number_slider_31, ZCoordinate=number_slider_32)  # disabled
construct_point_6 = ConstructPoint(XCoordinate=number_slider_33, YCoordinate=number_slider_34, ZCoordinate=number_slider_35)  # disabled
construct_point_7 = ConstructPoint(XCoordinate=number_slider_66, YCoordinate=number_slider_67, ZCoordinate=addition)  # disabled
construct_point_8 = ConstructPoint(XCoordinate=number_slider_66, YCoordinate=number_slider_67, ZCoordinate=number_slider_68)  # disabled
degrees = Degrees(Radians=pi_2)  # disabled
line_2 = Line(StartPoint=explode_tree.Branch0, EndPoint=explode_tree.Branch1)  # disabled
line_3 = Line(StartPoint=explode_tree.Branch1, EndPoint=explode_tree.Branch2)  # disabled
line_4 = Line(StartPoint=explode_tree.Branch2, EndPoint=explode_tree.Branch0)  # disabled
construct_point_9 = ConstructPoint(XCoordinate=number_slider_69, YCoordinate=number_slider_71, ZCoordinate=number_slider_72)  # disabled
_4point_surface = _4PointSurface(CornerA=point, CornerB=point_2, CornerC=point_3, CornerD=point_4)  # disabled
construct_point_10 = ConstructPoint(XCoordinate=number_slider_40, YCoordinate=number_slider_41, ZCoordinate=number_slider_42)  # disabled
construct_point_11 = ConstructPoint(XCoordinate=number_slider_43, YCoordinate=number_slider_44, ZCoordinate=number_slider_45)  # disabled
surface = Surface(_4point_surface)  # disabled

# ---- group: rs.AddPoints()
ghpython_script_19 = GhPythonScript(x=number_slider_37, y=number_slider_38, z=number_slider_39)  # -> out, rhino_points, a; disabled
# ---------- ghpython_script_19: Python ----------
import rhinoscriptsyntax as rs

rhino_points = rs.GetPoints(True, True, "Select points")
if rhino_points: 
    rs.AddPoints(rhino_points)

a = []
pointA = rs.AddPoint(x,y,z)
pointAA = rs.AddPoint(x*x,y*y,z*z)
pointAa = rs.AddPoint(x-y,y-z,z-x)
a.append(pointA)
a.append(pointAA)
a.append(pointAa)

if rhino_points: 
    a = rs.AddPoints(a)
# ---------- end ghpython_script_19 ----------

# ---- group: rs.PointAdd()
ghpython_script_20 = GhPythonScript(x=number_slider_46, y=number_slider_47, z=number_slider_48)  # -> out, a, point; disabled
# ---------- ghpython_script_20: Python ----------
import rhinoscriptsyntax as rs

a = rs.AddPoint( (x,y,z) )

point1 = (x*x,y*y,z*z)
point2 = (1,1,1)
point = rs.PointAdd(point1, point2)
# ---------- end ghpython_script_20 ----------

# ---- group: rs.AddCircle()
ghpython_script_21 = GhPythonScript(planeX=rotate_axis.Geometry, radius=number_slider_52)  # -> out, rhino_plane_out, python_circle_out; inputs planeX: Plane; disabled
# ---------- ghpython_script_21: Python ----------
import rhinoscriptsyntax as rs

rhino_plane = rs.WorldXYPlane()
rhino_plane_out = rs.AddCircle( rhino_plane, radius )
"""
python_circle_out = rs.AddCircle( planeX, radius )
"""
# ---------- end ghpython_script_21 ----------

# ---- group: rs.AddSrfPt()
ghpython_script_22 = GhPythonScript(x=point, y=point_2, z=point_3, u=point_4)  # -> out, xyzu, pointsSrf; inputs x: Point3d, y: Point3d, z: Point3d, u: Point3d; disabled
# ---------- ghpython_script_22: Python ----------
import rhinoscriptsyntax as rs

"""
points = rs.GetPoints(True, message1="Pick 3 or 4 corner points")
if points: 
    pointsSrf = rs.AddSrfPt(points)
"""

xyzu = rs.AddPoints([x,y,z,u])
pointsSrf = rs.AddSrfPt(xyzu)
"""
# ---------- end ghpython_script_22 ----------

# ---- group: rs.AddRectangle()
ghpython_script_23 = GhPythonScript(
    planeX=plane_3,
    rotation=degrees,
    x=number_slider_57,
    y=number_slider_58,
    z=number_slider_59,
    u=number_slider_60,
    v=number_slider_61,
    steps=number_slider_62)  # -> out, rhino_rectangle, list; inputs planeX: Plane, rotation: Int32, x: Int32, y: Int32, z: Int32, u: Int32, v: Int32, steps: Int32; disabled
# ---------- ghpython_script_23: Python ----------
import rhinoscriptsyntax as rs

list = []
for i in range(steps):
    plane = rs.RotatePlane(planeX, rotation, [x,y,z])
    python_rectangle = rs.AddRectangle( plane, u, v )
    list.append(python_rectangle)
print list
# ---------- end ghpython_script_23 ----------

# ---- group: rs.AddCurve()
ghpython_script_24 = GhPythonScript(pt1=construct_point_5, pt2=construct_point_6, degree=number_slider_76)  # -> out, rhino_curve, python_curve; inputs pt1: Point3d, pt2: Point3d, degree: Int32; disabled
# ---------- ghpython_script_24: Python ----------
import rhinoscriptsyntax as rs

points = rs.GetPoints(True, message1="Pick curve point")
print points
if points: 
    rhino_curve = rs.AddCurve(points, degree)

"""
points = rs.AddPoints([pt1,pt2])
python_curve = rs.AddCurve(points, degree)
"""
# ---------- end ghpython_script_24 ----------

# ---- group: rs.AddPlanarSrf()
ghpython_script_25 = GhPythonScript(crvA=line_2, crvB=line_3, crvC=line_4)  # -> out, planar_srf; inputs crvA: Curve, crvB: Curve, crvC: Curve, crvD: Curve; disabled
# ---------- ghpython_script_25: Python ----------
import rhinoscriptsyntax as rs

planar_srf = rs.AddPlanarSrf([crvA,crvB,crvC])
# ---------- end ghpython_script_25 ----------

# ---- group: rs.AddBox()
ghpython_script_26 = GhPythonScript(x=number_slider_73, y=number_slider_73)  # -> out, cornersA, cornersB, box_out; inputs x: Int32, y: Int32; disabled
# ---------- ghpython_script_26: Python ----------
import rhinoscriptsyntax as rs

cornersA = []
cornersB = []

for i in range(x):
    for j in range(y):
        cornersA.append(rs.AddPoint(i,j,0))
        cornersB.append(rs.AddPoint(i,j,3))
        

box_out = rs.AddBox([cornersA[0],cornersA[2],cornersA[3],cornersA[1],cornersB[0],cornersB[2],cornersB[3],cornersB[1]])
# ---------- end ghpython_script_26 ----------

# ---- group: rs.AddCone()
ghpython_script_27 = GhPythonScript(
    radius=number_slider_65,
    x=number_slider_66,
    y=number_slider_67,
    z=number_slider_68,
    base=construct_point_8,
    newBase=construct_point_7,
    h=number_slider_64)  # -> out, cone; inputs base: Point3d, newBase: Point3d; disabled
# ---------- ghpython_script_27: Python ----------
import rhinoscriptsyntax as rs

height = rs.AddPoint(x,y,z+h)
cone = rs.AddCone(base, newBase, radius)
# ---------- end ghpython_script_27 ----------

# ---- group: rs.AddEllipse()
ghpython_script_28 = GhPythonScript(x=number_slider_75, y=number_slider_74)  # -> out, list; inputs x: Int32, y: Int32; disabled
# ---------- ghpython_script_28: Python ----------
import rhinoscriptsyntax as rs

list = []

plane = rs.WorldXYPlane()
for i in range(x):
    for j in range(y):
        if i and j > 1:
            a = rs.AddEllipse( plane, x*i, y*j )
            list.append(a)
# ---------- end ghpython_script_28 ----------

# ---- group: rs.AddCone()
ghpython_script_29 = GhPythonScript(
    radius=number_slider_70,
    x=number_slider_69,
    y=number_slider_71,
    z=number_slider_72,
    base=construct_point_9,
    h=number_slider_77)  # -> out, cone; inputs base: Point3d; disabled
# ---------- ghpython_script_29: Python ----------
import rhinoscriptsyntax as rs

height = rs.AddPoint(x,y,z+h)
cone = rs.AddCone(base, height, radius)
# ---------- end ghpython_script_29 ----------

# ---- group: rs.AddLine()
ghpython_script_30 = GhPythonScript(start=construct_point_10, end=construct_point_11)  # -> out, rhino_line, python_line; inputs start: Point3d, end: Point3d; disabled
# ---------- ghpython_script_30: Python ----------
import rhinoscriptsyntax as rs

"""
start = rs.GetPoint("Start of line")
if start:
    end = rs.GetPoint("End of line")
    if end: 
        rhino_line = rs.AddLine(start, end)
"""
python_line = rs.AddLine(start, end)
# ---------- end ghpython_script_30 ----------

# ----
point_5 = Point(ghpython_script_20.a)  # disabled
point_6 = Point(ghpython_script_20.point)  # disabled
point_7 = Point(graft(ghpython_script_19.rhino_points))  # disabled
point_8 = Point(ghpython_script_19.a)  # disabled
line_5 = Line(StartPoint=point_5, EndPoint=point_6)  # disabled
panel_26 = Panel(point_6)  # disabled
panel_27 = Panel(point_5)  # disabled
panel_28 = Panel(point_7)  # disabled
line_6 = Line(StartPoint=point_7, EndPoint=point_8)  # disabled
panel_29 = Panel(point_8)  # disabled
panel_30 = Panel(ghpython_script_27.out)  # disabled
panel_31 = Panel(ghpython_script_25.planar_srf)  # disabled
panel_32 = Panel(ghpython_script_24.out)  # disabled
panel_33 = Panel(ghpython_script_29.cone)  # disabled
curve_2 = Curve(ghpython_script_23.list)  # disabled
curve_3 = Curve(ghpython_script_24.rhino_curve)  # disabled
line_7 = Line(ghpython_script_24.python_curve)  # disabled
rectangle = Rectangle(ghpython_script_23.rhino_rectangle)  # disabled
loft = Loft(
    Curves=flatten(curve_2),
    Options={Adjust=False, Closed=False, LoftEnds=0, LoftSimp=0, LoftType=0, Rebuild=10, Refit=0.01})  # disabled
point_9 = Point(ghpython_script_26.cornersA)  # disabled
point_10 = Point(ghpython_script_26.cornersB)  # disabled
box = Box(ghpython_script_26.box_out)  # disabled
point_11 = Point(ghpython_script_22.xyzu)  # disabled
surface_2 = Surface(ghpython_script_22.pointsSrf)  # disabled
line_8 = Line(ghpython_script_30.rhino_line)  # disabled
line_9 = Line(ghpython_script_30.python_line)  # disabled
plane_4 = Plane(ghpython_script_21.rhino_plane_out)  # disabled
circle_2 = Circle(ghpython_script_21.python_circle_out)  # disabled
panel_34 = Panel(ghpython_script_28.list)  # disabled
panel_35 = Panel(curve_2)  # disabled

# ----
# Transfomations
# rs.RotateObject()
# rs.ScaleObject()
# rs.MoveObject()
# rs.MirrorObject()
ghpython_script_31 = GhPythonScript()  # -> Out, A
number_slider_78 = Slider(0.83, range=0..10)  # disabled
quad_sphere = QuadSphere(Base=PlaneXY(0, 0, 0), Radius=1)  # disabled
number_slider_79 = Slider(5.67, range=0..10)  # disabled
number_slider_80 = Slider(3.69, range=0..10)  # disabled
number_slider_81 = Slider(2.57, range=0..10)  # disabled
number_slider_82 = Slider(5.49, range=0..10)  # disabled
number_slider_83 = Slider(3.57, range=0..10)  # disabled
quad_sphere_2 = QuadSphere(Base=PlaneXY(0, 0, 0), Radius=1)  # disabled
volume = Volume(Geometry=quad_sphere)  # -> Volume, Centroid; disabled
brep = Brep(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)  # disabled
number_slider_84 = Slider(3, range=0..10)  # disabled
center_box = CenterBox(Base=PlaneXY(0, 0, 0), X=1, Y=1, Z=1)  # disabled
number_slider_85 = Slider(2, range=1..6)  # disabled
vector_xyz = VectorXYZ(XComponent=number_slider_79, YComponent=number_slider_80, ZComponent=number_slider_81)  # -> Vector, Length; disabled
vector_xyz_2 = VectorXYZ(XComponent=number_slider_78, YComponent=number_slider_82, ZComponent=number_slider_83)  # -> Vector, Length; disabled
deconstruct_brep = DeconstructBrep(Brep=quad_sphere_2)  # -> Faces, Edges, Vertices; disabled
deconstruct_brep_2 = DeconstructBrep(Brep=quad_sphere)  # -> Faces, Edges, Vertices; disabled
number_slider_86 = Slider(180, range=0..180)  # disabled
volume_2 = Volume(Geometry=quad_sphere_2)  # -> Volume, Centroid; disabled
geometry_3 = Geometry(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)  # disabled
number_slider_87 = Slider(1.84, range=0..2)  # disabled
number_slider_88 = Slider(1.38, range=0..2)  # disabled
number_slider_89 = Slider(1.06, range=0..2)  # disabled
volume_3 = Volume(Geometry=center_box)  # -> Volume, Centroid; disabled
deconstruct_brep_3 = DeconstructBrep(Brep=center_box)  # -> Faces, Edges, Vertices; disabled
list_item = ListItem(List=deconstruct_brep.Vertices, Index=number_slider_84, Wrap=True)  # -> Item, Item1, Item2, Item3, Item4, Item5, Item6, Item7; disabled
volume_4 = Volume(Geometry=geometry_3)  # -> Volume, Centroid; disabled
construct_plane = ConstructPlane(Origin=Point(0, 0, 0), XAxis=vector_xyz.Vector, YAxis=vector_xyz_2.Vector)  # disabled
deconstruct_brep_4 = DeconstructBrep(Brep=geometry_3)  # -> Faces, Edges, Vertices; disabled
number_slider_90 = Slider(2, range=0..2)  # disabled
number_slider_91 = Slider(0.2, range=0..0.2)  # disabled
construct_domain = ConstructDomain(DomainStart=number_slider_91, DomainEnd=number_slider_90)  # disabled

# ---- group: rs.MoveObject()
ghpython_script_32 = GhPythonScript(id=quad_sphere, start=volume.Centroid, end=deconstruct_brep_2.Vertices, count=number_slider_85)  # -> out, a; inputs id: Brep, start: Point3d, end: Point3d, count: Int32; disabled
# ---------- ghpython_script_32: Python ----------
import rhinoscriptsyntax as rs

for i in range(count):
    if id:
        if start:
            if end:
                translation = end-start
                a = rs.MoveObject(id, translation)
# ---------- end ghpython_script_32 ----------

# ---- group: rs.RotateObject()
ghpython_script_33 = GhPythonScript(
    object=center_box,
    center=[volume_3.Centroid, deconstruct_brep_3.Vertices],
    degrees=number_slider_86,
    plane=construct_plane)  # -> out, a; inputs object: GeometryBase, center: Point3d, plane: Vector3d; disabled
# ---------- ghpython_script_33: Python ----------
import rhinoscriptsyntax as rs

if object:
    if center: 
        a = rs.RotateObject(object, center, degrees, plane, copy=False)
# ---------- end ghpython_script_33 ----------

# ---- group: rs.MirrorObject()
ghpython_script_34 = GhPythonScript(obj=quad_sphere_2, start=list_item.Item, end=[list_item.Item1, list_item.Item3, list_item.Item5, list_item.Item7])  # -> out, a; inputs obj: Brep, start: Point3d; disabled
# ---------- ghpython_script_34: Python ----------
import rhinoscriptsyntax as rs

if obj:
    if start and end:
        a = rs.MirrorObject( obj, start, end, True )
# ---------- end ghpython_script_34 ----------

# ---- group: rs.ScaleObject()
ghpython_script_35 = GhPythonScript(
    obj=geometry_3,
    origin=[volume_4.Centroid, deconstruct_brep_4.Vertices],
    x=number_slider_89,
    y=number_slider_87,
    z=number_slider_88)  # -> out, a; inputs obj: Brep, origin: Point3d; disabled
# ---------- ghpython_script_35: Python ----------
import rhinoscriptsyntax as rs

if origin:
    a = rs.ScaleObject( obj, origin, (x,y,z), True )
# ---------- end ghpython_script_35 ----------

# ----
geometry_4 = Geometry(flatten(ghpython_script_32.a))  # disabled
list_length_2 = ListLength(List=geometry_4)  # disabled
range_3 = Range(Domain=number_slider_90, Steps=expr("x-1", list_length_2))  # disabled
geometry_5 = Geometry(ghpython_script_34.a)  # disabled
geometry_6 = Geometry(ghpython_script_35.a)  # disabled
geometry_7 = Geometry(ghpython_script_33.a)  # disabled
list_item_2 = ListItem(List=geometry_5, Index=0, Wrap=True)  # -> Item, Item1, Item2, Item3; disabled
pi_3 = Pi(Factor=range_3)  # disabled
solid_intersection = SolidIntersection(BrepsA=list_item_2.Item, BrepsB=list_item_2.Item1)  # disabled
rotate_3d = Rotate3D(Geometry=flatten(geometry_4), Angle=pi_3, Center=volume.Centroid, Axis=Vector(0, 0, 1))  # -> Geometry, Transform; disabled
solid_intersection_2 = SolidIntersection(BrepsA=solid_intersection, BrepsB=list_item_2.Item2)  # disabled
range_4 = Range(Domain=construct_domain, Steps=expr("x-1", list_length_2))  # disabled
volume_5 = Volume(Geometry=rotate_3d.Geometry)  # -> Volume, Centroid; disabled
solid_intersection_3 = SolidIntersection(BrepsA=solid_intersection_2, BrepsB=list_item_2.Item3)  # disabled
scale = Scale(Geometry=rotate_3d.Geometry, Center=volume_5.Centroid, Factor=range_4)  # -> Geometry, Transform; disabled
