# Grasshopper definition vectors_002.gh (Grasshopper 1.0.7)
# Copyright: bernhard muller bijoutiers
# plug-ins: Workshop, Bifocals

# CHEATSHEET - Rhino Script Syntax
# WICKERSON STUDIOS
# SUBSCRIBE TO PATREON:
# https://www.patreon.com/MichaelWickerson?fan_landing=true
wickerson_s_first_grasshopper_component = WickersonsFirstGrasshopperComponent()

# ---- group: rs.GetString()
ghpython_script = GhPythonScript()  # -> out, a; disabled
# ---------- ghpython_script: Python ----------
import rhinoscriptsyntax as rs

a = rs.CurrentLayer()
a = rs.GetString("Layer to set current", a)
if a: 
    rs.CurrentLayer(a)
# ---------- end ghpython_script ----------

# ---- group: rs.VectorAngle()
ghpython_script_2 = GhPythonScript()  # -> out, a, b, n1; disabled
# ---------- ghpython_script_2: Python ----------
#dependent on rs.GetObject with rs.filter.surface
#dependent on rs.SurfaceDomain
#dependent on rs.SurfaceNormal

import rhinoscriptsyntax as rs
s0 = rs.GetObject("Surface 0", rs.filter.surface)
s1 = rs.GetObject("Surface 1", rs.filter.surface)
du0 = rs.SurfaceDomain(s0, 0)
dv0 = rs.SurfaceDomain(s0, 1)
du1 = rs.SurfaceDomain(s1, 0)
dv1 = rs.SurfaceDomain(s1, 1)
n0 = rs.SurfaceNormal(s0, (du0[0], dv0[0]))
n1 = rs.SurfaceNormal(s1, (du1[0], dv1[0]))
a = rs.VectorAngle(n0, n1)
b = rs.VectorAngle(n0, rs.VectorReverse(n1))
print a
print b
# ---------- end ghpython_script_2 ----------

# ---- group: rs.VectoLength()
ghpython_script_3 = GhPythonScript()  # -> out, vector; disabled
# ---------- ghpython_script_3: Python ----------
import rhinoscriptsyntax as rs

point1 = rs.GetPoint("First point")
point2 = rs.GetPoint("Next point")
vector = rs.VectorCreate(point2, point1)
print rs.VectorLength(vector)
# ---------- end ghpython_script_3 ----------

# ----
# point, line, surface, geometry
# rs.AddPoint()
# rs.AddPoints()
# rs.AddSrfPt()
# rs.AddLine()
# rs.AddCurve()
# rs.AddCircle()
# rs.AddRectangle()
# rs.AddPlanarSrf()
# rs.AddEllipse()
# rs.AddBox()
# rs.AddCone()
# rs.AddSweep1()
# rs.AddSweep2()
ghpython_script_4 = GhPythonScript()  # -> Out, A

# ----
# Transfomations
# rs.RotateObject()
# rs.ScaleObject()
# rs.MoveObjectt()
# rs.MirrorObject()
ghpython_script_5 = GhPythonScript()  # -> Out, A

# ----
# Miscellaneous
# rs.ExtendCurve()
# rs.AddLoftSrf()
# rs.OffsetCurve()
# rs.OffsetSurface()
# rs.ExtrudeSurface()
# rs.AddTextDot()
# rs.ObjectColor()
# rs.CopyObject()
# rs.DeleteObject()
# rs.HideObject()
# rs.EnableRedraw()
# rs.CurvePrepFrame()
# rs.WorldXYPlane()
# rs.ReverseCurve()
# rs.RebuildSurface()
# rs.JoinCurves()
ghpython_script_6 = GhPythonScript()  # -> Out, A

# ----
# Line, Curve, Surface Evaluation
# rs.Distance()
# rs.DivideCurve()
# rs.CurveMidPoint()
# rs.CurveAreaCentroid()
# rs.CurveStartPoint()
# rs.CurveEndPoint()
# rs.CurveClosestPoint()
# rs.CurveDomain()
# rs.BrepClosestPoint()
# rs.PointClosestPoint()
# rs.CurveDomain()
# rs.SurfaceDomain()
# rs.SurfaceNormal()
# rs.SurfaceAreaCentroid()
# rs.EvaluateSurface()
# rs.PlaneFromNormal()
# rs.DistanceToPlane()
# rs.PlaneFromPlane()
ghpython_script_7 = GhPythonScript()  # -> Out, A

# ----
# Selection and Input
# rs.GetString()
# rs.GetInteger()
# rs.GetReal()
# rs.GetObject()
# rs.GetObjects()
# rs.PointCoordinates()
panel = Panel("1234567890")  # disabled
panel_2 = Panel("1234567890")  # disabled
panel_3 = Panel("1234567890")  # disabled
panel_4 = Panel("Wickerson Studios Kicks Butt!")  # disabled
panel_5 = Panel("1234567890")  # disabled
panel_6 = Panel("1234567890")  # disabled
panel_7 = Panel(ghpython_script.a)  # disabled

# ---- group: rs.GetString()
ghpython_script_8 = GhPythonScript(x=panel_4)  # -> out, a; disabled
# ---------- ghpython_script_8: Python ----------
import rhinoscriptsyntax as rs

print x
a = rs.GetString(message="Enter a string", defaultString="Wickerson Studios", strings="Wickerson")
# ---------- end ghpython_script_8 ----------

# ---- group: rs.GetInteger()
ghpython_script_9 = GhPythonScript(x=panel)  # -> out, a; inputs x: Int32; disabled
# ---------- ghpython_script_9: Python ----------
import rhinoscriptsyntax as rs

print x

a = rs.GetInteger(message="Enter an integer.", number=123, minimum=100, maximum=256)
# ---------- end ghpython_script_9 ----------

# ---- group: rs.GetReal()
ghpython_script_10 = GhPythonScript(x=panel_5)  # -> out, a; inputs x: Int32; disabled
# ---------- ghpython_script_10: Python ----------
import rhinoscriptsyntax as rs

print x
a = rs.GetReal(message="Number", number=777, minimum=3, maximum=120)
# ---------- end ghpython_script_10 ----------

# ---- group: rs.GetObject
ghpython_script_11 = GhPythonScript(x=panel_2)  # -> out, a; inputs x: Int32; disabled
# ---------- ghpython_script_11: Python ----------
import rhinoscriptsyntax as rs

print x
import rhinoscriptsyntax as rs

a = rs.GetObject("Pick any object")
if a:
    print "Object identifier: ", a
"""
a = rs.GetObject("Pick a curve or surface", rs.filter.curve | rs.filter.surface)

if a:
    print "Object identifier: ", a
"""
# ---------- end ghpython_script_11 ----------

# ---- group: rs.GetObjects
ghpython_script_12 = GhPythonScript(x=panel_6)  # -> out, a; inputs x: Int32; disabled
# ---------- ghpython_script_12: Python ----------
print x

import rhinoscriptsyntax as rs

a = []
objectIds = rs.GetObjects("Pick some surfaces", rs.filter.surface)
for id in objectIds: 
    print "Object identifier:", id
    a.append(id)
# ---------- end ghpython_script_12 ----------

# ---- group: rs.PointCoordinates()
ghpython_script_13 = GhPythonScript(x=panel_3)  # -> out, a; inputs x: Int32; disabled
# ---------- ghpython_script_13: Python ----------
print x

import rhinoscriptsyntax as rs

a = rs.GetObject("Select point", rs.filter.point)
point = rs.PointCoordinates(a)
if point: 
    print point
# ---------- end ghpython_script_13 ----------

# ----
panel_8 = Panel(ghpython_script_12.out)  # disabled
panel_9 = Panel(ghpython_script_11.out)  # disabled
panel_10 = Panel(ghpython_script_8.out)  # disabled
panel_11 = Panel(ghpython_script_9.a)  # disabled
panel_12 = Panel(ghpython_script_10.a)  # disabled
panel_13 = Panel(ghpython_script_8.a)  # disabled
panel_14 = Panel(ghpython_script_9.out)  # disabled
panel_15 = Panel(ghpython_script_10.out)  # disabled
panel_16 = Panel(ghpython_script_11.a)  # disabled
panel_17 = Panel(ghpython_script_12.a)  # disabled
panel_18 = Panel(ghpython_script_13.out)  # disabled
panel_19 = Panel(ghpython_script_13.a)  # disabled

# ----
# vectors
# rs.AddPoint()
# rs.VectorCreate()
# rs.VectorUnitize()
# rs.VectorAngle()
# rs.VectorScale()
# rs.VectorLength()
number_slider = Slider(0, range=0..10)
number_slider_2 = Slider(10, range=0..10)
number_slider_3 = Slider(4, range=0..10)
number_slider_4 = Slider(2, range=0..10)  # disabled
number_slider_5 = Slider(3, range=0..10)  # disabled
number_slider_6 = Slider(5, range=0..10)  # disabled
number_slider_7 = Slider(1, range=-2..2)  # disabled
number_slider_8 = Slider(-0.42, range=-2..2)  # disabled
number_slider_9 = Slider(0.28, range=-2..2)  # disabled
number_slider_10 = Slider(0.44, range=0..10)  # disabled
number_slider_11 = Slider(2.09, range=0..10)  # disabled
number_slider_12 = Slider(7.7, range=0..10)  # disabled
number_slider_13 = Slider(1.7, range=0..10)  # disabled
number_slider_14 = Slider(2.09, range=0..10)  # disabled
number_slider_15 = Slider(2.09, range=0..10)  # disabled
number_slider_16 = Slider(0, range=0..10)  # disabled
number_slider_17 = Slider(1.9, range=0..10)  # disabled
number_slider_18 = Slider(2.29, range=0..10)  # disabled
number_slider_19 = Slider(2, range=0..10)  # disabled
number_slider_20 = Slider(2.76, range=0..10)  # disabled
number_slider_21 = Slider(5.64, range=0..10)  # disabled
number_slider_22 = Slider(1.06, range=0..10)  # disabled
construct_point = ConstructPoint(XCoordinate=number_slider, YCoordinate=number_slider_2, ZCoordinate=number_slider_3)
construct_point_2 = ConstructPoint(XCoordinate=number_slider_2, YCoordinate=number_slider, ZCoordinate=number_slider_3)
number_slider_23 = Slider(1, range=0..100)  # disabled
line = Line(StartPoint=construct_point_2, EndPoint=construct_point)
number_slider_24 = Slider(1, range=0..100)  # disabled
number_slider_25 = Slider(1, range=0..100)  # disabled
panel_20 = Panel(ghpython_script_3.out)  # disabled
vector = Vector(ghpython_script_3.vector)  # disabled
panel_21 = Panel(ghpython_script_2.out)  # disabled
panel_22 = Panel(ghpython_script_2.a)  # disabled
panel_23 = Panel(ghpython_script_2.b)  # disabled
number_slider_26 = Slider(7, range=0..100)  # disabled
amplitude = Amplitude(Vector=vector, Amplitude=number_slider_23)  # disabled
number_slider_27 = Slider(2, range=0..100)  # disabled
vector_display = VectorDisplay(Anchor=vector, Vector=amplitude)  # disabled
amplitude_2 = Amplitude(Vector=ghpython_script_2.n1, Amplitude=number_slider_27)  # disabled
vector_display_2 = VectorDisplay(Anchor=ghpython_script_2.n1, Vector=amplitude_2)  # disabled

# ---- group: rs.VectoLength()
ghpython_script_14 = GhPythonScript(a=number_slider_2, b=number_slider, c=number_slider_3)  # -> out, vector, list; inputs a: Int32, b: Int32, c: Int32
# ---------- ghpython_script_14: Python ----------
import rhinoscriptsyntax as rs

list = []
for i in range(a):
    x = rs.AddPoint(a,b,c)
    y = rs.AddPoint(a*a,b*b,c*c)
    vector = rs.VectorCreate(x, y)
    vectorList = rs.VectorLength(i*vector)
    list.append(vectorList)
# ---------- end ghpython_script_14 ----------

# ---- group: rs.VectorCreate()
ghpython_script_15 = GhPythonScript(
    x=number_slider_12,
    y=number_slider_13,
    z=number_slider_10,
    deltaX=number_slider_14,
    deltaY=number_slider_15,
    deltaZ=number_slider_11)  # -> out, rhino_vector, ghpython_vector; disabled
# ---------- ghpython_script_15: Python ----------
import rhinoscriptsyntax as rs
"""
point1 = rs.GetPoint("First point")
point2 = rs.GetPoint("Next point")
rhino_vector = rs.VectorCreate(point2, point1)
print rhino_vector
"""
point3 = rs.AddPoint(x,y,z)
point4 = rs.AddPoint(deltaX, deltaY,deltaZ)
ghpython_vector = rs.VectorCreate(point3, point4)
print ghpython_vector
# ---------- end ghpython_script_15 ----------

# ---- group: rs.AddPoint()
ghpython_script_16 = GhPythonScript(
    x=number_slider_4,
    y=number_slider_5,
    z=number_slider_6,
    multX=number_slider_7,
    multY=number_slider_8,
    multZ=number_slider_9)  # -> out, point_out; inputs x: Int32, y: Int32, z: Int32; disabled
# ---------- ghpython_script_16: Python ----------
import rhinoscriptsyntax as rs

point1 = (x,y,z)
point2 = (multX*x,multY*y,multZ*z)
point = rs.PointAdd(point1, point2)
print point

point_out = point

rs.PointAdd(
# ---------- end ghpython_script_16 ----------

# ---- group: rs.VectorScale()
ghpython_script_17 = GhPythonScript(x=number_slider_17, y=number_slider_17, z=number_slider_18, scale=number_slider_19)  # -> out, vector; inputs scale: Int32; disabled
# ---------- ghpython_script_17: Python ----------
import rhinoscriptsyntax as rs

vector = rs.VectorScale([x,y,z], scale)
print vector
# ---------- end ghpython_script_17 ----------

# ---- group: rs.VectorUnitize()
ghpython_script_18 = GhPythonScript(x=number_slider_20, y=number_slider_21, z=number_slider_22)  # -> out, vector; disabled
# ---------- ghpython_script_18: Python ----------
import rhinoscriptsyntax as rs
vector = rs.VectorUnitize( [x,y,z] )
print vector
# ---------- end ghpython_script_18 ----------

# ----
vector_2 = Vector(ghpython_script_14.vector)
amplitude_3 = Amplitude(Vector=vector_2, Amplitude=ghpython_script_14.list)
vector_3 = Vector(ghpython_script_18.vector)  # disabled
panel_24 = Panel(ghpython_script_16.point_out)  # disabled
panel_25 = Panel(ghpython_script_16.out)  # disabled
vector_4 = Vector(ghpython_script_17.vector)  # disabled
list_length = ListLength(List=amplitude_3)
vector_5 = Vector(ghpython_script_15.ghpython_vector)  # disabled
vector_6 = Vector(ghpython_script_15.rhino_vector)  # disabled
panel_26 = Panel(ghpython_script_14.list)
amplitude_4 = Amplitude(Vector=vector_4, Amplitude=number_slider_24)  # disabled
amplitude_5 = Amplitude(Vector=vector_3, Amplitude=number_slider_25)  # disabled
range = Range(Domain=Slider(1.85, range=0..2), Steps=expr("x-1", list_length))
rotate = Rotate(Vector=amplitude_3, Axis=line, Angle=range)
vector_display_3 = VectorDisplay(Anchor=vector_4, Vector=amplitude_4)  # disabled
vector_display_4 = VectorDisplay(Anchor=vector_3, Vector=amplitude_5)  # disabled
amplitude_6 = Amplitude(Vector=vector_6, Amplitude=number_slider_26)  # disabled
amplitude_7 = Amplitude(Vector=vector_5, Amplitude=number_slider_26)  # disabled
vector_display_5 = VectorDisplay(Anchor=rotate, Vector=rotate)
vector_display_6 = VectorDisplay(Anchor=vector_5, Vector=amplitude_7)  # disabled
vector_display_7 = VectorDisplay(Anchor=vector_6, Vector=amplitude_6)  # disabled
